# Dynamo graph Ismail_1.dyn (Dynamo 2.5.0.7460)

explode = Geometry.Explode()  # unwired: geometry
categories = Categories("OST_Mass")
all_elements_of_category = ElementsOfCategory(Category=categories)
geometry = Element.Geometry(element=all_elements_of_category)
explode_2 = Geometry.Explode(geometry=geometry)
number_slider = DoubleSlider(2, range=0..2 step 1)
getItemAtIndex = List.GetItemAtIndex(list=explode_2, index=number_slider)
number_slider_2 = DoubleSlider(4, range=0..4 step 1)
getItemAtIndex_2 = List.GetItemAtIndex(list=getItemAtIndex@L2, index=number_slider_2)
faces = Topology.Faces(topology=getItemAtIndex_2)
edges = Topology.Edges(topology=getItemAtIndex_2)
vertices = Topology.Vertices(topology=getItemAtIndex_2)
number_slider_3 = DoubleSlider(0, range=0..2 step 1)
getItemAtIndex_3 = List.GetItemAtIndex(list=vertices@L2, index=number_slider_3)
pointGeometry = Vertex.PointGeometry(vertex=getItemAtIndex_3)

# group: move
ZAxis = Vector.ZAxis()
translate = Geometry.Translate(geometry=pointGeometry, direction=ZAxis)
XAxis = Vector.XAxis()
YAxis = Vector.YAxis()
